% Requirement links of Requisitos_NASH_Planta_MCP_ER_Prop_V1e_.slreqx (R2020a)

#26 verifies #18: 001-F-MCP-011: O modelo do MCP deve representar a potência do motor em kW de acordo com a figura D.1 do EST-270.
#27 verifies #22: 001-F-MCP-015: Quando virando, o modelo deve representar a dinâmica do motor entre 600 e 2000 rpm, conforme detalhado no IPQM-REL-156.